# Grasshopper definition test.gh (Grasshopper 1.0.7)
# plug-ins: ICD.AbmFramework.Grasshopper

number_slider = Slider(50, range=0..100)

boolean_toggle = BooleanToggle(True)  # disabled
button = Button()  # disabled
c_script = CSharpScript(Reference=["C:\Users\77777777\AppData\Roaming\Grasshopper\Libraries\AgentBasedModelling.dll", "C:\Users\77777777\AppData\Roaming\Grasshopper\Libraries\ICD.AbmFramework.Core.dll"])  # -> out, A; disabled
# ---------- c_script: C# usings ----------
using AgentBasedModelling;
using ICD.AbmFramework.Core.Behavior;
using ICD.AbmFramework.Core.Agent;
# ---------- c_script: C# ----------
    ActiveCell c = new ActiveCell(0.0, 0.0, 0.0);
    CellEnvironment e = new CellEnvironment();
    WalkBehavior b = new WalkBehavior();

    c.Behaviors = new List<BehaviorBase>();
    c.Behaviors.Add(b);

    CellAgentSystem s = new CellAgentSystem();
    s.Agents = new List<AgentBase>();
    s.Agents.Add(c);

    A = s;
# ---------- end c_script ----------
step_by_step_solver = StepByStepSolver(Reset=button, Execute=boolean_toggle, AgentSystems=c_script.A)  # -> DisplayGeometries, AllAgentSystems, IterationCount; disabled
panel = Panel(c_script.A)  # disabled

boolean_toggle_2 = BooleanToggle(True)
point = Point([Point(-0.6832625241, -1.936264799, 0), Point(3.701285749, 0.9232232051, 0)])
xy_plane = XYPlane(Origin=point)
timer = Timer(TimerInterval=20, Target=c_script_2)
c_script_2 = CSharpScript(
    Reset=Button(),
    Execute=Toggle(False),
    Poses=xy_plane,
    Reference=["C:\Users\77777777\AppData\Roaming\Grasshopper\Libraries\AgentBasedModelling.dll", "C:\Users\77777777\AppData\Roaming\Grasshopper\Libraries\ICD.AbmFramework.Core.dll"])  # -> out, A, B, C, D; inputs Reset: Boolean, Execute: Boolean, Poses: list of Plane; disabled
# ---------- c_script_2: C# usings ----------
using AgentBasedModelling;
using ICD.AbmFramework.Core;
using ICD.AbmFramework.Core.Behavior;
using ICD.AbmFramework.Core.Agent;
using ICD.AbmFramework.Core.AgentSystem;
# ---------- c_script_2: C# ----------
    if(Reset) solver = init(Poses);
    if(Execute) solver.ExecuteSingleStep();



    // display
    CellAgentSystem s = solver.AgentSystems[0] as CellAgentSystem;
    A = s.Cells;
    B = s.IsActive;
    C = s.PlaceToConnect;
    D = solver;
# ---------- c_script_2: C# additional code ----------
  Solver solver;

  static Solver init(List<Plane> Poses){
    Cell activeCell = new Cell(0, 0, true);
    Cell passiveCell = new Cell(0, 0, false);
    Cell passiveCell2 = new Cell(1, 0, false);
    Cell passiveCell3 = new Cell(1, -1, false);

    //CellEnvironment envir = new CellEnvironment();
    WanderBehavior behaviorW = new WanderBehavior();
    MergeBehavior behaviorM = new MergeBehavior();
    //List<BehaviorBase> behaviors = new List<BehaviorBase>();
    //behaviors.Add(behaviorW);
    //behaviors.Add(behaviorM);

    CellGroup g1 = new CellGroup(activeCell, 3.0);
    g1.Behaviors.Add(behaviorW);
    g1.Behaviors.Add(behaviorM);

    g1.Cells.Add(passiveCell2);
    g1.Cells.Add(passiveCell3);
    CellGroup g2 = new CellGroup(passiveCell, 3.0);
    g2.Behaviors.Add(behaviorW);
    g2.Behaviors.Add(behaviorM);

    g1.Pose = Poses[0];
    g2.Pose = Poses[1];

    //cell.Behaviors = new List<BehaviorBase>();
    //cell.Behaviors.Add(behavior);

    CellAgentSystem system = new CellAgentSystem(3.0);
    system.Agents = new List<AgentBase>();
    system.Agents.Add(g1);
    system.Agents.Add(g2);

    List<AgentSystemBase> systems = new List<AgentSystemBase>();
    systems.Add(system);

    Solver solver = new Solver(systems);
    return solver;
  }
# ---------- end c_script_2 ----------
panel_2 = Panel(c_script_2.A)
cull_pattern = CullPattern(List=c_script_2.A, CullPattern=c_script_2.B)
panel_3 = Panel(c_script_2.D)
boundary_surfaces = BoundarySurfaces(Edges=cull_pattern)

number_slider_2 = Slider(6, range=0..10)  # disabled
curve = Curve([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])  # disabled
list_item = ListItem(List=curve, Index=number_slider_2, Wrap=True)  # disabled
explode = Explode(Curve=list_item, Recursive=True)  # -> Segments, Vertices; disabled
area = Area(Geometry=list_item)  # -> Area, Centroid; disabled
list_item_2 = ListItem(List=explode.Vertices, Index=0, Wrap=True)  # -> Item, Item1, Item2; disabled
vector_2pt = Vector2Pt(PointA=area.Centroid, PointB=list_item_2.Item, Unitize=False)  # -> Vector, Length; disabled
vector_2pt_2 = Vector2Pt(PointA=list_item_2.Item2, PointB=list_item_2.Item1, Unitize=False)  # -> Vector, Length; disabled
area_2 = Area(Geometry=curve)  # -> Area, Centroid; disabled
construct_plane = ConstructPlane(Origin=area.Centroid, XAxis=vector_2pt_2.Vector, YAxis=vector_2pt.Vector)  # disabled
number_slider_3 = Slider(14, range=0..14)  # disabled
list_item_3 = ListItem(List=area_2.Centroid, Index=number_slider_3, Wrap=True)  # disabled
c_script_3 = CSharpScript(
    Poses=construct_plane,
    x=list_item_3,
    Reference=["C:\Users\77777777\AppData\Roaming\Grasshopper\Libraries\AgentBasedModelling.dll", "C:\Users\77777777\AppData\Roaming\Grasshopper\Libraries\ICD.AbmFramework.Core.dll"])  # -> out, A; inputs Poses: list of Plane, x: Point3d; disabled
# ---------- c_script_3: C# ----------
    Cell activeCell = new Cell(0, 0, true);
    WanderBehavior behavior = new WanderBehavior();

    CellGroup g1 = new CellGroup(activeCell, behavior, 3.0);
    g1.Pose = Poses[0];
    Cell cell = g1.GetCellFromPoint(x);
    A = g1.GetPose(cell);
# ---------- end c_script_3 ----------
list_item_4 = ListItem(List=c_script_3.A, Index=number_slider_3, Wrap=True)  # disabled
list_item_5 = ListItem(List=curve, Index=number_slider_3, Wrap=True)  # disabled

populate_2d = Populate2D(
    Region={Plane=PlaneXY(2.322681477, 4.935231324, 0), Size=Domain2(u=-47.30505458..47.30505458, v=-43.82674175..43.82674175)},
    Count=number_slider,
    Seed=1)
random = Random(Range=Domain(0, 1), Number=number_slider, Seed=2)
random_2 = Random(Range="0 To Pi * 2", Number=number_slider, Seed=2)
xy_plane_2 = XYPlane(Origin=populate_2d)
smaller_than = SmallerThan(FirstNumber=random, SecondNumber="0.125")  # -> SmallerThan, OrEqualTo
rotate_plane = RotatePlane(Plane=xy_plane_2, Angle=random_2)
timer_2 = Timer(TimerInterval=20, Target=c_script_4)
c_script_4 = CSharpScript(
    Reset=Button(),
    Execute=Toggle(True),
    Poses=rotate_plane,
    IsActive=smaller_than.SmallerThan,
    size="3.0",
    Reference=["C:\Users\77777777\AppData\Roaming\Grasshopper\Libraries\AgentBasedModelling.dll", "C:\Users\77777777\AppData\Roaming\Grasshopper\Libraries\ICD.AbmFramework.Core.dll"])  # -> out, A, B, C, D; inputs Reset: Boolean, Execute: Boolean, Poses: list of Plane, IsActive: list of Boolean, size: Double
# ---------- c_script_4: C# ----------
    if(Reset) solver = init(Poses, IsActive, size);
    if(Execute) solver.ExecuteSingleStep();



    // display
    CellAgentSystem s = solver.System;
    A = s.Cells;
    B = s.State;
    C = s.PlaceToConnect;
    D = s.IterationCount;
# ---------- c_script_4: C# additional code ----------
  MySolver solver;

  static MySolver init(List<Plane> Poses, List<bool> IsActive, double size){
    // define system
    CellAgentSystem system = new CellAgentSystem(size);
    system.Agents = new List<AgentBase>();

    // define behaviors
    WanderBehavior behaviorW = new WanderBehavior();
    MergeBehavior behaviorM = new MergeBehavior();
    // generate cellGroups
    for (int i = 0; i < Poses.Count; i++)
    {
      // define cell
      Cell cell;
      if(IsActive[i]) cell = new Cell(0, 0, true);
      else cell = new Cell(0, 0, false);
      // define cellGroup
      CellGroup g = new CellGroup(cell, size);
      g.Pose = Poses[i];
      g.Behaviors.Add(behaviorW);
      g.Behaviors.Add(behaviorM);
      // add cell group to the system
      system.Agents.Add(g);
    }
    // create solver
    MySolver solver = new MySolver(system);
    return solver;
  }
# ---------- end c_script_4 ----------
panel_4 = Panel(c_script_4.D)
panel_5 = Panel(c_script_4.A)
cull_pattern_2 = CullPattern(List=c_script_4.A, CullPattern=c_script_4.B)
boundary_surfaces_2 = BoundarySurfaces(Edges=cull_pattern_2)
